# Grasshopper definition GeneratingPolyline.gh (Grasshopper 1.0.7)

# # **Data in Design, AI for Urban Data and Visualization**
# 
# #### Data, Design Computation, Artificial Intelligence, Visualization, Harvard GSD
# 
# 
# **KEYWORD:**
# Vector, Raster, Urban Data, GIS, Data Processing, Data Mining, Machine Learning, Artificial Intelligence, Visualization, Mapping, Design Decision-Making
# 
# -----
# 
# #### Instructor : NJ Namju Lee / nj.namju@gmail.com
# ###### * Linkedin - https://www.linkedin.com/in/nj-namju-lee-926b3252/    * Git - https://github.com/NamjuLee
# 
# ###### * Web - http://www.njstudio.co.kr                                  * Lab - http://www.njslab.com/NJSLabCore/
# 
# ###### * Video(English) - https://www.youtube.com/c/njnamjulee            * Writing(English) - https://medium.com/@nj-namju
# 
# ###### * Video(Korean) - https://www.youtube.com/c/CodeforDesign          * Writing(Korean) - https://brunch.co.kr/@njnamju
# -----
geo = Geometry(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)
c_script = CSharpScript(pl=geo)  # -> out, A, B; inputs pl: Polyline
# ---------- c_script: C# ----------
    A = pl.Count;

    double[] pos = new double[pl.Count * 2];

    for(int i = 0 ; i < pl.Count; ++i) {
      int index = i * 2;
      pos[index] = pl[i].X;
      pos[index + 1] = pl[i].Y;
    }
    A = pos;
    
    string thePos = "";
    for(int i = 0 ; i < pos.Length; ++i) {
      thePos += pos[i].ToString() + ",";
    }
    
    
    B = thePos.Remove(thePos.Length - 1, 1);
# ---------- end c_script ----------
panel = Panel(c_script.A)
panel_2 = Panel(c_script.B)
